# Grasshopper definition 29 - Rhino to ComfyUI.gh (Grasshopper 1.0.8)
# plug-ins: Physalia

chat = Chat(ChatboxEmoji="🐙")
pick = Picker(SelectedValue="Rhino to ComfyUI.txt")
prjfld = ProjectFolder(ProjectFolder="comfy-render")  # -> Grounding, Folder
toolsused = ToolsPresent()
addimg = AddImage()
viewsnap = ViewSnapshot(MessageOverrideSet=False, SendWithMessage=False)
pick_2 = Picker(SelectedValue="gpt-5.6-luna")
codex = CodexModel(Model=pick_2)
fc = FeedbackCollector()
fc_2 = FeedbackCollector()
fc_3 = FeedbackCollector()
fc_4 = FeedbackCollector()
no_schema = Panel(" ")
system_prompt = SystemPrompt(Preamble=pick, Schema=no_schema)  # -> Schema, SystemPrompt
conversation_log = ConversationLog(
    SystemPrompt=system_prompt.SystemPrompt,
    PromptSignal=chat,
    Grounding=[toolsused, prjfld.Grounding],
    HumanTools=[addimg, viewsnap],
    ResponseSignal=fc,
    LLMToolSignal=fc_2)
llm_call = LLMCall(Model=codex, Cancel=False, Signal=conversation_log)  # -> SuccessSignal, FailSignal, ToolCalls
rtr = Router(ToolCalls=llm_call.ToolCalls, Results=[fc_3, fc_4])  # -> T1, T2, Feedback
comfyui = MCPServer(Signal=rtr.T1, Server="comfy", Advertise=True, mcpToolsSet=False)  # -> Tool, Result, Status
rhinopy = DriveRhino(Signal=rtr.T2, Advertise=True)  # -> Tool, Result, LastScript
llm_errors = Panel(llm_call.FailSignal)
fb = Feedback(Signal=llm_call.SuccessSignal, CollectorGuid_0=fc)
fb_2 = Feedback(Signal=rtr.Feedback, CollectorGuid_0=fc_2)
fb_3 = Feedback(Signal=comfyui.Result, CollectorGuid_0=fc_3)
fb_4 = Feedback(Signal=rhinopy.Result, CollectorGuid_0=fc_4)
