# Grasshopper definition Codex - Incremental Nodes.gh (Grasshopper 1.0.8)
# plug-ins: Physalia

# ----
# PROMPTING, GROUNDING, & TOOLS
# The 'system prompt' component provides a system prompt to the LLM. See: https://www.kern-it.be/en/definitions/system-prompt/
# 
# In Physalia, the prompt is split into two parts. The preamble is the 'motivational speech'. "You are
# a GH expert who only works with nodes", "You work in Rhinocommon in Python 3", etc.
# 
# The Schema defines how the LLM formats its response.
# 
# For nodes, we use Physalia uses GHJSON: https://github.com/architects-toolkit/ghjson-dotnet
# Many thanks to this project.
# 
# For Python and C#, we use custom JSON schemas.
# 
# You can add your own schemas or modify schema
# via the files in: Physalia/Files/SYSTEM_PROMPTS
# The 'chat' component is the component that creates the
# chat window for interacting with your harness.
# 
# You may have more that one chat window per harness.
# The icon shown on a given chat component will show up as a tab in the UI.
# 'Grounding' Componets append additional document based information to the system prompt.
# 
# In this instance, the "Document's Units Grounding" appends the document units to the system prompt.
# "Component Catalog" allows you to choose which components you want the LLM to use.
# (I find limiting the LLM makes it more effective.)
# The "Physalia Grouping" component tells the LLM to place the components it generates
# within a group and to only alter components within that group.
# The 'Tools' grounding tells the LLM which Physalia tools it may call.
# 
# Groundings may have tweakable setting via the chat UI under "Grounding & Tool Options".
pick = Picker(SelectedValue="Incremental Node Graph.txt")
pick_2 = Picker(SelectedValue="Incremental Node Graph.json")
component_catalog = ComponentCatalog(IncludeLegacy=False)
chat = Chat(ChatboxEmoji="🦦")
ungnd = DocumentUnitsGrounding()
phygrp = PhysaliaGroupComponents()
# 'Human Tools' are tools that you use!
# 
# 'Add Image' allows you to paste or drag images into the chat window.
# 'View Snapshot' allows you to take a snap of the current Rhino view.
# 'Signal Trace' gives you an advanced view into how signals are coursing
# through your harness definition. Good for troubleshooting.
# 'Export Conversation' allows you to save you chat as a .txt file.
tools_present = ToolsPresent()
add_image = AddImage()
view_snapshot = ViewSnapshot(SendWithMessage=True)
export_conversation = ExportConversation()
signal_trace = SignalTrace()
system_prompt = SystemPrompt(Preamble=pick, Schema=pick_2)  # -> Schema, SystemPrompt

# ----
# Use the 'harness notes' component
# to add descriptive text to a harness
# you build. These notes will show
# up in the chat UI.
harness_notes = HarnessNotes(
    HarnessNotes="""A tool-calling harness driven by a OpenAI Codex that incrementally places grasshopper nodes on the canvas. Will also create Rhino geometry if asked.

This harness also demonstrates the grouping and planning capabilities of Physalia. Guardrails are shown in a maximal configuration!

GPT 5.6 Luna by default.""",
    HarnessNotesWidth=240)

# ----
# MODEL
# Just make sure Claude Code is installed on your machine and you are good to go!
# 
# Note that Codex CAN use Physalia tool calls!
pick_3 = Picker(SelectedValue="gpt-5.6-luna")
codex_model = CodexModel(Model=pick_3)

# ----
# FEEDBACK
# Physalia breaks the rules of Grasshopper's DAG. To have a multiturn conversation with an LLM we need to provide some sort of feedback.
# 
# To do so we use a 'Feedback' component to send data back to a 'Feedback Collector' component.
# 
# In the topmost wire we send the LLM's response back to the response signal input of the conversation log so that it can be recorded in the log.
# 
# The lower wires are sending fail signal feedback from the Guardrails so that they can be fed as 'user messages' to the LLM, automatically prompting it to correct its mistakes.
feedback_collector = FeedbackCollector()
feedback_collector_2 = FeedbackCollector()
feedback_collector_3 = FeedbackCollector()

# ----
# RECORDING STATE
# The 'conversation log' component records
# your interactions with the LLM.
# 
# For the most part, LLM's are stateless. They don't remember things.
# We need to record the entire conversation history and resubmit for
# each and every conversation turn.
# 
# The conversation log outputs a 'signal'.
conversation_log = ConversationLog(
    SystemPrompt=system_prompt.SystemPrompt,
    PromptSignal=chat,
    Grounding=[component_catalog, phygrp, ungnd, tools_present],
    HumanTools=[add_image, view_snapshot, signal_trace, export_conversation],
    ResponseSignal=feedback_collector_3,
    FeedbackSignal=feedback_collector_2,
    LLMToolSignal=feedback_collector,
    ClusterSelectionSet=False,
    ExposeComponentSignatures=False,
    GroundingSelectionSet=False,
    SnapshotMessageSet=False,
    ToolsSelectionSet=False,
    UnitsOverrideSet=False,
    ViewSnapshotMessageSet=False)

# ----
# COMPACTION
# 'Compaction' components reduce the length of the conversation signal submitted to an LLM in order
# stay within a given model's context window.
# 
# https://www.ibm.com/think/topics/context-window
# 
# For Antrhopic models, we won't often hit our context limits, but it's worth adding compaction as a fail safe.
# We can use the 'token window' component to remove earlier messages
# if our input is exceeding 80% of the context window (0.8*x in Max Tokens Input).
# 
# We can find out a local model's max input via the LlammaCpp model info component.
pick_4 = Picker(SelectedValue="Anthropic")
tokenization_techniques = TokenizationTechniques(Technique=pick_4)
token_window = TokenWindow(TokenizationTechnique=tokenization_techniques, MaxTokens=expr("x*0.8", 8000), Signal=conversation_log)

# ----
# THE SIGNAL DATA TYPE
# A 'signal' is Physalia's base data object.
# 
# Each signal carries a few pieces of data:
# 
# Sequence - a number indicating its position in the overall chain of events.
# Success - a boolean used for routing.
# Payload - a textual representation of the signal's contents.
# Source - the component which generated the signal
# Time - the time the signal was generated
# Instructions - the conversation log object if the signal is a converation.
deconstruct_signal = DeconstructSignal(Signal=conversation_log)  # -> Sequence, Success, Payload, Source, Time, Instructions
instructions_decompositor = InstructionsDecompositor(Instructions=deconstruct_signal.Instructions)  # -> SystemPrompt, Messages
message_decompositor = MessageDecompositor(Message=instructions_decompositor.Messages)  # -> Role, Content

# ----
# LLM CALL
# The 'LLM Call' component sends the contents
# of the conversation log component to the LLM
# provider defined by the model components.
# 
# This happens asynchronously. Feel free to keep
# working while Physalia is solving.
# 
# A success signal is any successful response from the LLM provider.
# Successful in this context simply means that a response was returned.
# The content of the response might be wrong or malformed.
# 
# A fail signal from the model component means that a call to the provider was not
# successful. Check the signal to troubleshoot the problem.
# 
# Tool Calls are calls to internal 'LLM Tools' made by
# the LLM. These tool calls must be passed into a 'Tool Call Router' component.
# Codex can make tool calls through it's experimental 'Dynamic Tools' (August 2026)
button = Button()
llm_call = LLMCall(Model=codex_model, Cancel=button, Signal=token_window)  # -> SuccessSignal, FailSignal, ToolCalls
llm_api_errors_go_here = Panel(llm_call.FailSignal)

feedback = Feedback(Signal=llm_call.SuccessSignal, CollectorGuid_1=feedback_collector_3)

# ----
# PRE-PLACEMENT GUARDRAILS
# Guardrails are deterministic gates that will only allow a signal to move forward if certain conditions are met.
# 
# Guardrails (minus 'Detect Json') send fail signals back to the conversation log in order to self correct the LLM.
# 
# GH node placement requires more guardrails thancode generation because we don't have a code
# interpreter generating errors to feedback.
# Schema validator checks the JSON emitted by
# the LLM against the chosen schema to ensure
# it is properly formed.
# 
# The actual contents of the JSON (Python code,
# node placement, etc.) are checked downstream.
# Whereas 'Schema Validator' preps the signal to
# only include valid JSON. 'GH Definition Validator'
# ensures that the signal only contains valid GHJSON
# data.
# 'Build Plan' can be used in conjunction with the
# incremental node system prompts.
# 
# It will return a 'progress report' back to the model
# to keep things on track.
# 'Detect JSON' blocks LLM responses
# NOTcontaining JSON from passing through.
# 
# This is neccesary if you want the LLM to be able
# to chat without responding in a structured format.
# 'Required Input Checker' ensures that the nodes
# that the LLM placed actually have inputs.
# 'Component Resolver' ensures that the components
# the LLM chose actually exist!
detect_json = DetectJSON(Signal=llm_call.SuccessSignal)
plan = BuildPlan(Signal=detect_json)  # -> Signal, Progress
schema_validator = SchemaValidator(Schema=system_prompt.Schema, Signal=plan.Signal)  # -> SuccessSignal, FailSignal
defvalid = GHDefinitionValidator(Signal=schema_validator.SuccessSignal)  # -> SuccessSignal, FailSignal
component_resolver = ComponentResolver(ComponentCatalog=component_catalog, Signal=defvalid.SuccessSignal)  # -> SuccessSignal, FailSignal
reqin = RequiredInputCheck(Signal=component_resolver.SuccessSignal)  # -> SuccessSignal, FailSignal

# ----
# TOOL CALLS
# Tools are useful in-physalia functions that the LLM
# can call.
# 
# In this case, the LLM can call a tool to look up components.
# It can also create rhino geometry an reference it
# back into grasshopper
feedback_collector_4 = FeedbackCollector()
router = Router(ToolCalls=llm_call.ToolCalls, Results=feedback_collector_4)  # -> Create_rhino_geometry, Search_components, Feedback
feedback_2 = Feedback(Signal=router.Feedback, CollectorGuid_0=feedback_collector)
component_catalog_2 = ComponentCatalog(IncludeLegacy=False)
component_search = ComponentSearch(Signal=router.Search_components, ComponentCatalog=component_catalog_2)  # -> Tool, Result
rhino_geometry = RhinoGeometry(Signal=router.Create_rhino_geometry)  # -> Tool, Result
feedback_3 = Feedback(Signal=rhino_geometry.Result, CollectorGuid_0=feedback_collector_4)
feedback_4 = Feedback(Signal=component_search.Result, CollectorGuid_0=feedback_collector_4)

# ----
# TRANSMITTERS
# Transmitters are only Physalia components
# that pass information out of a harness and onto
# the main Grasshopper canvas.
# 
# This pass out happens automatically and will be
# represented by an output on the harness component
# on the main canvas.
# 
# You may have as many transmitters as you wish.
component_transmitter = ComponentTransmitter(Signal=reqin.SuccessSignal, LenientBase=False)  # -> SuccessSignal, FailSignal

# ----
# FLOW CONTROL
# The 'Stall Guard' will stop the LLM from working
# if it generates the same error N times in a row.
# 
# Useful for weaker models that sometimes spiral.
stall = StallGuard(
    StallLimit=3,
    Signal=[schema_validator.FailSignal, defvalid.FailSignal, component_resolver.FailSignal, reqin.FailSignal, component_transmitter.FailSignal])
feedback_5 = Feedback(Signal=stall, CollectorGuid_1=feedback_collector_2)

# ----
# POST-PLACEMENT GUARDRAILS
# 'Geometry Observation' takes a screen capture of
# the generated geometry and feeds it back to the LLM.
# 
# You can add a message to override it's default message.
# We are leaving the message blank since we are
# merging this signal with the 'Geometry Report' below.
# 'Runtime Health Check' returns errors and warnings to the LLM to consider.
# 'Geometry Report' generates a textual description of
# the geometry the LLM generated.
# 
# It has a default message which can be overridden.
# In this instance we are passing in the message
# from 'Building Plan' which allows the LLM
# to judge it's created geometry against the current
# stage in its plan.
runtime_health_check = RuntimeHealthCheck(Signal=component_transmitter.SuccessSignal, FailOnWarnings=True)  # -> SuccessSignal, FailSignal
empty_on_purpose = Panel(" ")
geometry_observation = GeometryObservation(Message=empty_on_purpose, Signal=runtime_health_check.SuccessSignal)
geometry_report = GeometryReport(Message=plan.Progress, Signal=runtime_health_check.SuccessSignal)

# ----
# FLOW CONTROL
# 'Merge Signal' waits until all its inputs have fired and then
# forwards a signal. In this case, we are combining both
# the visual snapshot and geometry report to give
# the LLM a full picture of what it's done.
merge_signal = MergeSignal(Signal1=geometry_observation, Signal2=geometry_report)
feedback_6 = Feedback(Signal=merge_signal, CollectorGuid_1=feedback_collector_2)
