# Grasshopper definition Local LLM - Python 3.gh (Grasshopper 1.0.8)
# plug-ins: Physalia

# ----
# PROMPTING, GROUNDING, & TOOLS
# The 'system prompt' component provides a system prompt to the LLM. See: https://www.kern-it.be/en/definitions/system-prompt/
# 
# In Physalia, the prompt is split into two parts. The preamble is the 'motivational speech'. "You are
# a GH expert who only works with nodes", "You work in Rhinocommon in Python 3", etc.
# 
# The Schema defines how the LLM formats its response.
# 
# For nodes, we use Physalia uses GHJSON: https://github.com/architects-toolkit/ghjson-dotnet
# Many thanks to this project.
# 
# For Python and C#, we use custom JSON schemas.
# 
# You can add your own schemas or modify schema
# via the files in: Physalia/Files/SYSTEM_PROMPTS
# The 'chat' component is the component that creates the
# chat window for interacting with your harness.
# 
# You may have more that one chat window per harness.
# The icon shown on a given chat component will show up as a tab in the UI.
# 'Grounding' Componets append additional document based information to the system prompt.
# 
# In this instance, the "Document's Units Grounding" appends the document units to the system prompt.
# 'Script I/O' appends the inputs and outputs of the scripting component so the LLM knows what you want.
# 'Tools Present' tells the LLM what Physalia tools it can call.
# 
# Groundings may have tweakable setting via the chat UI under "Grounding & Tool Options".
pick = Picker(SelectedValue="Python3 Script.txt")
pick_2 = Picker(SelectedValue="Python3 Script.json")
chat = Chat(ChatboxEmoji="🦀")
interface_lock = InterfaceLock(LinkedGuid=py_transmitter)
document_units_grounding = DocumentUnitsGrounding()
tools_present = ToolsPresent()
system_prompt = SystemPrompt(Preamble=pick, Schema=pick_2)  # -> Schema, SystemPrompt

# ----
# Use the 'harness notes' component
# to add descriptive text to a harness
# you build. These notes will show
# up in the chat UI.
harness_notes = HarnessNotes(
    HarnessNotes="""A harness driven by a local model running via LlamaCpp. You set the inputs / outputs on the Python 3 component - the LLM fills in the code.

This harness also demonstrates tool calls (so make sure your local LLM can call them!)""",
    HarnessNotesWidth=240)

# ----
# MODEL
# For a local model run through LlammaCpp, if supported you can adjust
# the reasoning effort, Temperature, etc.
# 
# The address shown is the default for LlammaCPP
llamacpp_standard_address = Panel("http://127.0.0.1:8080")
pick_3 = Picker(SelectedValue="Qwen_Qwen3-14B-Q4_K_M.gguf")
openai_compatible_model = OpenAICompatibleModel(BaseURL=llamacpp_standard_address, Model=pick_3, MaxTokens=4096)
openai_compatible_tweaker = OpenAICompatibleTweaker(Model=openai_compatible_model, Temperature=1, TopP=1, MaxTokens=4096, ReasoningEffort="low")

# ----
# FEEDBACK
# Physalia breaks the rules of Grasshopper's DAG. To have a multiturn conversation with an LLM we need to provide some sort of feedback.
# 
# To do so we use a 'Feedback' component to send data back to a 'Feedback Collector' component.
# 
# In the topmost wire we send the LLM's response back to the response signal input of the conversation log so that it can be recorded in the log.
# 
# The lower wires are sending fail signal feedback from the Guardrails so that they can be fed as 'user messages' to the LLM, automatically prompting it to correct its mistakes.
feedback_collector = FeedbackCollector()
feedback_collector_2 = FeedbackCollector()
feedback_collector_3 = FeedbackCollector()

# ----
# RECORDING STATE
# The 'conversation log' component records
# your interactions with the LLM.
# 
# For the most part, LLM's are stateless. They don't remember things.
# We need to record the entire conversation history and resubmit for
# each and every conversation turn.
# 
# The conversation log outputs a 'signal'.
conversation_log = ConversationLog(
    SystemPrompt=system_prompt.SystemPrompt,
    PromptSignal=chat,
    Grounding=[document_units_grounding, interface_lock, tools_present],
    ResponseSignal=feedback_collector_3,
    FeedbackSignal=feedback_collector_2,
    LLMToolSignal=feedback_collector,
    ClusterSelectionSet=False,
    ExposeComponentSignatures=False,
    GroundingSelectionSet=False,
    SnapshotMessageSet=False,
    ToolsSelectionSet=False,
    UnitsOverrideSet=False,
    ViewSnapshotMessageSet=False)

# ----
# THE SIGNAL DATA TYPE
# A 'signal' is Physalia's base data object.
# 
# Each signal carries a few pieces of data:
# 
# Sequence - a number indicating its position in the overall chain of events.
# Success - a boolean used for routing.
# Payload - a textual representation of the signal's contents.
# Source - the component which generated the signal
# Time - the time the signal was generated
# Instructions - the conversation log object if the signal is a converation.
deconstruct_signal = DeconstructSignal(Signal=conversation_log)  # -> Sequence, Success, Payload, Source, Time, Instructions
instructions_decompositor = InstructionsDecompositor(Instructions=deconstruct_signal.Instructions)  # -> SystemPrompt, Messages
message_decompositor = MessageDecompositor(Message=instructions_decompositor.Messages)  # -> Role, Content

# ----
# COMPACTION
# 'Compaction' components reduce the length of the conversation signal submitted to an LLM in order
# stay within a given model's context window.
# 
# https://www.ibm.com/think/topics/context-window
# 
# For local models we definitely need to ensure we are staying within their context Window.
# We can use the 'token window' component to remove earlier messages
# if our input is exceeding 80% of the context window (0.8*x in Max Tokens Input).
# 
# We can find out a local model's max input via the LlammaCpp model info component.
pick_4 = Picker(SelectedValue="Heuristic")
llamacpp_model_info = LlamaCppModelInfo(Model=openai_compatible_tweaker)  # -> MaxInput, MaxOutput, ImageCapable, ToolCapable
tokenization_techniques = TokenizationTechniques(Technique=pick_4)
token_window = TokenWindow(
    TokenizationTechnique=tokenization_techniques,
    MaxTokens=expr("x*0.8", llamacpp_model_info.MaxInput),
    Signal=conversation_log)

# ----
# LLM CALL
# The 'LLM Call' component sends the contents
# of the conversation log component to the LLM
# provider defined by the model components.
# 
# This happens asynchronously. Feel free to keep
# working while Physalia is solving.
# 
# A success signal is any successful response from the LLM provider.
# Successful in this context simply means that a response was returned.
# The content of the response might be wrong or malformed.
# 
# A fail signal from the model component means that a call to the provider was not
# successful. Check the signal to troubleshoot the problem.
# 
# Tool Calls are calls to internal 'LLM Tools' made by
# the LLM. These tool calls must be passed into a 'Tool Call Router' component.
button = Button()
llm_call = LLMCall(Model=openai_compatible_model, Cancel=button, Signal=token_window)  # -> SuccessSignal, FailSignal, ToolCalls
llm_api_errors_go_here = Panel(llm_call.FailSignal)

# ----
# TOOL CALLS
# Tools are pre-written pieces of code that the LLM
# can use to perform certain tasks.
# 
# https://alnutile.medium.com/what-are-tools-in-the-scope-of-llms-and-why-are-they-so-important-f57f76190e58
# 
# In this case, we provide the local model with the 'RhinoCommon Tool'. Rather than guessing what a particular
# RhinoCommon function does, the model can simply search all available functionality within the library.
# 
# The tool router component gather feedback from the tools and feeds the results back to the conversavtion log.
feedback_collector_4 = FeedbackCollector()
router = Router(ToolCalls=llm_call.ToolCalls, Results=feedback_collector_4)  # -> Search_rhinocommon, Feedback
rhinocommon_search = RhinoCommonSearch(Signal=router.Search_rhinocommon)  # -> Tool, Result
feedback = Feedback(Signal=rhinocommon_search.Result, CollectorGuid_0=feedback_collector_4)

# ----
# GUARDRAILS
# Guardrails are deterministic gates that will only allow a signal to move forward if certain conditions are met.
# 
# Guardrails (minus 'Detect Json') send fail signals back to the conversation log in order to self correct the LLM.
# Schema validator checks the JSON emitted by
# the LLM against the chosen schema to ensure
# it is properly formed.
# 
# The actual contents of the JSON (Python code,
# node placement, etc.) are checked downstream.
# 'Detect JSON' blocks LLM responses
# NOTcontaining JSON from passing through.
# 
# This is neccesary if you want the LLM to be able
# to chat without responding in a structured format.
detect_json = DetectJSON(Signal=llm_call.SuccessSignal)
schema_validator = SchemaValidator(Schema=system_prompt.Schema, Signal=detect_json)  # -> SuccessSignal, FailSignal

# ----
# TRANSMITTERS
# Transmitters are only Physalia components
# that pass information out of a harness and onto
# the main Grasshopper canvas.
# 
# This pass out happens automatically and will be
# represented by an output on the harness component
# on the main canvas.
# 
# You may have as many transmitters as you wish.
py_transmitter = PyTransmitter(Signal=schema_validator.SuccessSignal)  # -> SuccessSignal, FailSignal

feedback_2 = Feedback(Signal=llm_call.SuccessSignal, CollectorGuid_0=feedback_collector_3)
feedback_3 = Feedback(Signal=router.Feedback, CollectorGuid_0=feedback_collector)
feedback_4 = Feedback(Signal=schema_validator.FailSignal, CollectorGuid_0=feedback_collector_2)
feedback_5 = Feedback(Signal=py_transmitter.FailSignal, CollectorGuid_0=feedback_collector_2)
