# Grasshopper definition Codex - Blender.gh (Grasshopper 1.0.8)
# plug-ins: Physalia

chat = Chat(ChatboxEmoji="🐠")
pick = Picker(SelectedValue="Blender Modelling.txt")
toolsused = ToolsPresent()
addimg = AddImage()
pick_2 = Picker(SelectedValue="gpt-5.6-luna")
codex = CodexModel(Model=pick_2)
fc = FeedbackCollector()
fc_2 = FeedbackCollector()
fc_3 = FeedbackCollector()
no_schema = Panel(" ")
system_prompt = SystemPrompt(Preamble=pick, Schema=no_schema)  # -> Schema, SystemPrompt
conversation_log = ConversationLog(
    SystemPrompt=system_prompt.SystemPrompt,
    PromptSignal=chat,
    Grounding=toolsused,
    HumanTools=addimg,
    ResponseSignal=fc,
    LLMToolSignal=fc_2)
llm_call = LLMCall(Model=codex, Cancel=False, Signal=conversation_log)  # -> SuccessSignal, FailSignal, ToolCalls
rtr = Router(ToolCalls=llm_call.ToolCalls, Results=fc_3)  # -> T1, Feedback
blender = MCPServer(Signal=rtr.T1, Server="blender", Advertise=True, mcpToolsSet=False)  # -> Tool, Result, Status
llm_errors = Panel(llm_call.FailSignal)
fb = Feedback(Signal=llm_call.SuccessSignal, CollectorGuid_0=fc)
fb_2 = Feedback(Signal=rtr.Feedback, CollectorGuid_0=fc_2)
fb_3 = Feedback(Signal=blender.Result, CollectorGuid_0=fc_3)
