# Grasshopper definition Watch and Repeat.gh (Grasshopper 1.0.8)
# plug-ins: Physalia

preamble = Picker(SelectedValue="Rhino Scripting.txt")
system_prompt = SystemPrompt(Preamble=preamble)  # -> Schema, SystemPrompt
watch = WatchModelling(CaptureCommandLine=False)  # -> Signal, Steps, StepCount
chat = Chat(ChatboxEmoji="🦞")
rhdoc = RhinoDocument()
toolsused = ToolsPresent()
co_response = FeedbackCollector()
co_tool_round = FeedbackCollector()
conversation_log = ConversationLog(
    SystemPrompt=system_prompt.SystemPrompt,
    PromptSignal=[chat, watch.Signal],
    Grounding=[rhdoc, toolsused],
    ResponseSignal=co_response,
    LLMToolSignal=co_tool_round)
budget = BudgetGuard(MaxTokens=300000, MaxCalls=60, Extension=0.5, Signal=conversation_log)  # -> SuccessSignal, FailSignal, Spent
model = Picker(SelectedValue="sonnet")
claudecode = ClaudeCodeModel(Model=model)
llm_call = LLMCall(Model=claudecode, Cancel=False, Signal=budget.SuccessSignal)  # -> SuccessSignal, FailSignal, ToolCalls
fb_response = Feedback(Signal=llm_call.SuccessSignal, CollectorGuid_0=co_response)
co_results = FeedbackCollector()
rtr = Router(ToolCalls=llm_call.ToolCalls, Results=co_results)  # -> Run_rhino_script, Ask_human, Memory, Feedback
memory = Memory(Signal=rtr.Memory, MemoryFolder="modelling-procedures", Advertise=True)  # -> Tool, Result
rhinopy = DriveRhino(Signal=rtr.Run_rhino_script, Advertise=True)  # -> Tool, Result, LastScript
ask = AskHuman(Signal=rtr.Ask_human, Advertise=True)  # -> Tool, Result, Answer, Selection
fb_tool_round = Feedback(Signal=rtr.Feedback, CollectorGuid_0=co_tool_round)
fb_results = Feedback(Signal=[rhinopy.Result, ask.Result, memory.Result], CollectorGuid_0=co_results)
