# Grasshopper definition claude_code_incremental.gh (Grasshopper 1.0.8)
# plug-ins: Physalia

pick = Picker(SelectedValue="Incremental Node Graph.txt")
pick_2 = Picker(SelectedValue="Incremental Node Graph.json")
chat = Chat(ChatboxEmoji="🐠")
component_catalog = ComponentCatalog(IncludeLegacy=False)
phygrp = PhysaliaGroupComponents()
ungnd = DocumentUnitsGrounding()
system_prompt = SystemPrompt(Preamble=pick, Schema=pick_2)  # -> Schema, SystemPrompt
fc = FeedbackCollector()
fc_2 = FeedbackCollector()
conversation_log = ConversationLog(
    SystemPrompt=system_prompt.SystemPrompt,
    PromptSignal=chat,
    Grounding=[component_catalog, phygrp, ungnd],
    ResponseSignal=fc,
    FeedbackSignal=fc_2,
    ClusterSelectionSet=False,
    ExposeComponentSignatures=False,
    GroundingSelectionSet=False,
    SnapshotMessageSet=False,
    ToolsSelectionSet=False,
    UnitsOverrideSet=False,
    ViewSnapshotMessageSet=False)
pick_3 = Picker(SelectedValue="sonnet")
claudecode = ClaudeCodeModel(Model=pick_3)
llm_call = LLMCall(Model=claudecode, Cancel=Button(), Signal=conversation_log)  # -> SuccessSignal, FailSignal, ToolCalls
siglim = SignalLimiter(Signal=llm_call.SuccessSignal, Count=40, Reset=False)  # -> WithinLimit, OverLimit
fb = Feedback(Signal=llm_call.SuccessSignal, CollectorGuid_0=fc)
djson = DetectJSON(Signal=siglim.WithinLimit)
plan = BuildPlan(Signal=djson)  # -> Signal, Progress
schema_validator = SchemaValidator(Schema=system_prompt.Schema, Signal=plan.Signal)  # -> SuccessSignal, FailSignal
defvalid = GHDefinitionValidator(Signal=schema_validator.SuccessSignal)  # -> SuccessSignal, FailSignal
component_resolver = ComponentResolver(ComponentCatalog=component_catalog, Signal=defvalid.SuccessSignal)  # -> SuccessSignal, FailSignal
reqin = RequiredInputCheck(Signal=component_resolver.SuccessSignal)  # -> SuccessSignal, FailSignal
comptx = ComponentTransmitter(Signal=reqin.SuccessSignal, LenientBase=False)  # -> SuccessSignal, FailSignal
runtime_health_check = RuntimeHealthCheck(Signal=comptx.SuccessSignal, FailOnWarnings=True)  # -> SuccessSignal, FailSignal
geometry_report = GeometryReport(Message=plan.Progress, Signal=runtime_health_check.SuccessSignal)
stall = StallGuard(
    StallLimit=3,
    Signal=[geometry_report, schema_validator.FailSignal, defvalid.FailSignal, component_resolver.FailSignal, reqin.FailSignal, comptx.FailSignal, runtime_health_check.FailSignal])
fb_2 = Feedback(Signal=stall, CollectorGuid_0=fc_2)
