# Grasshopper definition START_HERE.gh (Grasshopper 1.0.8)
# plug-ins: Physalia

# ----
# 00. WELCOME TO PHYSALIA
# 01. SET UP AN API KEY
# right click icon ('provider' label) and select:
# "Edit API Keys file"
# 
# Paste the API key into the proper field. Save the file.
# 
# My suggestion would be to try out the free
# models on OpenCode Zen or OpenRouter first.
# 
# Putting $20 on Anthropic and using Sonnet
# has given me great results and been all the
#  credits I've needed to develop this plugin so far!
# 
# Gemini (google) has a free tier but I was hitting limits.
# 
# OpenAI and the others work but I personally
# don't use them.
# 
# You can also just run claude or ollama and the
#  plugin will connect. Check the Food4Rhino
#  page for tutorials coming soon!
# 
# Below are the URLs select providers (April 2026)
# GET AN ANTHROPIC (CLAUDE) KEY HERE: https://platform.claude.com
# GET A GEMINI (GOOGLE) KEY HERE: https://aistudio.google.com/
provider = Provider()
# This is a limited functionality alpha
# version of Physalia. An opensource,
# free LLM exploration plugin for GH.
# 
# 
# Much expanded version coming
# Summer 2026!
# 
# 
# To check on progress, visit:
# https://github.com/aarcThom/Physalia
# 
# Or, drop me a message on the
# Rhino Forums (Thomas_Gaudin) or at:
# thomas@aarc.io
# 
# 
# This version will not be actively
# maintained / modified as I'll
# be focusing my energy on the
# beta.
# 
# 
# Let me know if you'd like to
# contribute. - TG
get_an_opencode_zen_api_key_here_free_mo = Panel("https://opencode.ai/auth")  # "GET AN OPENCODE ZEN API KEY HERE (FREE MODELS!)"
get_an_openrouter_api_key_here_free_mode = Panel("https://openrouter.ai/")  # "GET AN OPENROUTER API KEY HERE (FREE MODELS!)"

# ----
# 02. SELECT A PROVIDER
# click the arrow to select a provider that
# you've set up an API key for.
provider_2 = Provider(SelectedProvider="openrouter")

# ----
# 03. SELECT A MODEL
# hook up the model component and
# select an available model.
# 
# Note that OpenCode Zen and
# OpenRouter will list 'free' at the
# end of free models.
provider_3 = Provider(SelectedProvider="openrouter")
model = Model(Provider=provider_3, SelectedModel="google/gemma-4-26b-a4b-it:free")

# ----
# 04. HOOK UP COMPOSER (PROMPT) AND YOUR MODEL TO TRANSMITTER
# Composer is where you interact with the LLM.
# 
# Transmitter is what takes your prompt, formats
# it and sends it to the LLM.
# 
# Attach a panel to the Log output to see the machine
# formatted prompt, or receive errors from the API.
provider_4 = Provider(SelectedProvider="openrouter")
composer = Composer()
model_2 = Model(Provider=provider_4, SelectedModel="google/gemma-4-26b-a4b-it:free")
transmitter = Transmitter(Llm=model_2, Prompt=composer, AutoFix=True, FixAttempts=3)
panel = Panel(transmitter)

# ----
# 05B. SETUP A CLUSTER COMPONENT
# Drag out from transmitter to ClusterReceiver just like you would with galapagos.
# 
# Zoom into ClusterReceiver and add input and output parameters. (Physalia uses this to drive the prompt.)
# 
# It is suggested that you hook up the inputs and output BEFORE submitting a prompt.
# That way, the LLM can actually auto-fix using feedback.
provider_5 = Provider(SelectedProvider="openrouter")
composer_2 = Composer()
model_3 = Model(Provider=provider_5, SelectedModel="google/gemma-4-26b-a4b-it:free")
transmitter_2 = Transmitter(Llm=model_3, Prompt=composer_2, AutoFix=True, FixAttempts=3)
panel_2 = Panel(transmitter_2)
brep = Brep(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)
clusterreceiver = ClusterReceiver(
    Brep_in=brep,
    Number_of_points=Slider(86, range=10..100),
    Random_seed=Slider(45, range=10..100),
    InternalDocumentXml="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")

# ----
# 05A. SETUP A PYTHON COMPONENT
# Drag out from transmitter to PyReceiver just like you would with galapagos.
# 
# Zoom into PyReceiver and add input and output parameters. (Physalia uses this to drive the prompt.)
# 
# It is suggested that you hook up the inputs and output BEFORE submitting a prompt.
# That way, the LLM can actually auto-fix using feedback.
provider_6 = Provider(SelectedProvider="openrouter")
composer_3 = Composer()
model_4 = Model(Provider=provider_6, SelectedModel="google/gemma-4-26b-a4b-it:free")
transmitter_3 = Transmitter(Llm=model_4, Prompt=composer_3, AutoFix=True, FixAttempts=3)
panel_3 = Panel(transmitter_3)
brep_2 = Brep(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)
pyreceiver = PyReceiver(Brep_in=brep_2, Number_of_points=Slider(86, range=10..100), Random_seed=Slider(45, range=10..100))

# ----
# 06B. GENERATE A CLUSTER COMPONENT
# double click to open cluster
provider_7 = Provider(SelectedProvider="anthropic")
composer_4 = Composer(
    LLM_Content_0="for a given input brep generate a bunch of random points.",
    LLM_Content_1="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",
    LLM_Content_2="""The cluster has errors. Return a corrected JSON response in the same format.

  - Wire source "c2.Min" not found. "c2" (Deconstruct Box) has outputs: [P, X, Y, Z]
  - Wire source "c2.Max" not found. "c2" (Deconstruct Box) has outputs: [P, X, Y, Z]
  - Wire source "c9.points" not found. "c9" (Merge) has outputs: [R]

Runtime errors from inner components:
  - [points_out] Floating parameter points_out failed to collect data
  - [Box from Corners] Input parameter A failed to collect data
  - [Box from Corners] Input parameter B failed to collect data
  - [Populate 3D] Input parameter R failed to collect data
  - [Point In Brep] Input parameter P failed to collect data
  - [Filter Inside Points] Input parameter L failed to collect data
  - [Filter Inside Points] Input parameter P failed to collect data

Current inner document state (use exact NickNames for wiring):
  Inputs: brep_in, number_of_points, random_seed
  Outputs: points_out
  Components:
    comp0 (Bounding Box "Bounding Box"): inputs [C(←input.brep_in), P]  outputs [B, B]
    comp1 (Deconstruct Box "Deconstruct Box"): inputs [B(←comp0.B)]  outputs [P, X, Y, Z]
    comp2 (Box 2Pt "Box from Corners"): inputs [A, B, P]  outputs [B]
    comp3 (Populate 3D "Populate 3D"): inputs [R(←comp2.B), N(←input.number_of_points), S(←input.random_seed), P]  outputs [P]
    comp4 (Point In Brep "Point In Brep"): inputs [B(←input.brep_in), P(←comp3.P), S]  outputs [I]
    comp5 (Dispatch "Filter Inside Points"): inputs [L(←comp3.P), P(←comp4.I)]  outputs [A, B]
    comp6 (Merge "Merge Inside Points"): inputs [D1(←comp5.A), D2]  outputs [R]
    comp7 (Param "")
    comp8 (Param "")
    comp9 (Param "")
  Output wiring:
    points_out ← (none)

YOU MUST USE EXACTLY THESE INPUT PARAMETERS — do not add, remove, or rename any:

  name: brep_in
  prettyName: <derive a human-readable label from "brep_in">
  tooltip: <short description derived from your implementation.
  typeHint: Brep
  access: item
  optional: false

  name: number_of_points
  prettyName: <derive a human-readable label from "number_of_points">
  tooltip: <short description derived from your implementation.
  typeHint: Number
  access: item
  optional: false

  name: random_seed
  prettyName: <derive a human-readable label from "random_seed">
  tooltip: <short description derived from your implementation.
  typeHint: Number
  access: item
  optional: false

YOU MUST USE EXACTLY THESE OUTPUT PARAMETERS — do not add, remove, or rename any:

  name: points_out
  prettyName: <derive a human-readable label from "points_out">
  tooltip: <short description derived from your implementation>""",
    LLM_Content_3="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",
    LLM_Role_0="user",
    LLM_Role_1="assistant",
    LLM_Role_2="user",
    LLM_Role_3="assistant",
    LLM_Status_1="Generates random points inside a Brep using population sampling and containment filtering.",
    LLM_Status_3="Generates random points inside a Brep using bounding box population and containment filtering.",
    human_msg_0="""You:
for a given input brep generate a bunch of random points.""",
    human_msg_1="""LLM:
Generates random points inside a Brep using population sampling and containment filtering.""",
    human_msg_2="""Physalia:
Sending autofix request to LLM.""",
    human_msg_3="""LLM:
Generates random points inside a Brep using bounding box population and containment filtering.""")
model_5 = Model(Provider=provider_7, SelectedModel="claude-sonnet-4-6")
transmitter_4 = Transmitter(Llm=model_5, Prompt=composer_4, AutoFix=True, FixAttempts=3)
panel_4 = Panel(transmitter_4)
brep_3 = Brep(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)
clusterreceiver_2 = ClusterReceiver(
    Brep_in=brep_3,
    Number_of_points=Slider(86, range=10..100),
    Random_seed=Slider(45, range=10..100),
    ClusterResponseJson="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",
    InternalDocumentXml="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")

# ----
# 06A. GENERATE A PYTHON COMPONENT
# Double click Composer in the lower portion to enter a prompt.
# When in editing mode hit 'SHIFT + ENTER' to submit a prompt.
# 
# Right click composer and click 'reset conversation' to clear a conversation.
# 
# Physalia will attempt to autofix if needed, and if 'Autofix' is set to true.
# 
# You can continue to add additional inputs
# and outputs and enter more prompts!
# double click to open python editor
provider_8 = Provider(SelectedProvider="anthropic")
composer_5 = Composer(
    LLM_Content_0="For a given brep, generate a bunch of random points inside.",
    LLM_Content_1="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",
    LLM_Content_2="""The script has errors that need fixing. Return a corrected JSON response in the same format.

Static analysis errors:
  Lint failed: Can not determine language for "b0d4efc2-71eb-4097-9059-be65c7663f9b"

YOU MUST USE EXACTLY THESE INPUT PARAMETERS — do not add, remove, or rename any:

  name: brep_in
  prettyName: <derive a human-readable label from "brep_in">
  tooltip: <short description derived from your implementation.
  typeHint: Brep
  access: item
  optional: false

  name: number_of_points
  prettyName: <derive a human-readable label from "number_of_points">
  tooltip: <short description derived from your implementation.
  typeHint: Number
  access: item
  optional: false

  name: random_seed
  prettyName: <derive a human-readable label from "random_seed">
  tooltip: <short description derived from your implementation.
  typeHint: Number
  access: item
  optional: false

YOU MUST USE EXACTLY THESE OUTPUT PARAMETERS — do not add, remove, or rename any:

  name: points_out
  prettyName: <derive a human-readable label from "points_out">
  tooltip: <short description derived from your implementation>""",
    LLM_Content_3="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",
    LLM_Role_0="user",
    LLM_Role_1="assistant",
    LLM_Role_2="user",
    LLM_Role_3="assistant",
    LLM_Status_1="Generated a script that populates a Brep volume with random interior points using bounding-box rejection sampling.",
    LLM_Status_3="Fixed the script by ensuring proper integer casting and clean Python 3 syntax compatible with Grasshopper's script component.",
    human_msg_0="""You:
For a given brep, generate a bunch of random points inside.""",
    human_msg_1="""LLM:
Generated a script that populates a Brep volume with random interior points using bounding-box rejection sampling.""",
    human_msg_2="""Physalia:
Sending autofix request to LLM.""",
    human_msg_3="""LLM:
Fixed the script by ensuring proper integer casting and clean Python 3 syntax compatible with Grasshopper's script component.""")
model_6 = Model(Provider=provider_8, SelectedModel="claude-sonnet-4-6")
transmitter_5 = Transmitter(Llm=model_6, Prompt=composer_5, AutoFix=True, FixAttempts=3)
panel_5 = Panel(transmitter_5)
brep_4 = Brep(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)
pyreceiver_2 = PyReceiver(
    Brep_in=brep_4,
    Number_of_points=Slider(86, range=10..100),
    Random_seed=Slider(45, range=10..100),
    ScriptResponse="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")
